# Dynamo graph RoomFinishAreas 7-23-26.dyn (Dynamo 4.0.2.3852)
# packages: DynamoIronPython3 1.6.0

# group: DO NOT MODIFY!
categories = Categories("OST_Rooms")
all_elements_of_category = ElementsOfCategory(Category=categories)
code_block = CodeBlock { "Wall Finish Area"; "Floor Finish Area"; "Ceiling Finish Area"; }
boolean = BoolSelector(true)
boolean_2 = BoolSelector(true)
python_script = Python(IN[0]=all_elements_of_category, IN[1]=code_block.out0, IN[2]=code_block.out1, IN[3]=code_block.out2, IN[4]=boolean, IN[5]=boolean_2)  # PythonNet3; unwired: IN[6]
# ---------- python_script.python (1653 lines) ----------
# ============================================================
# Room Finish Surface Areas -> Room Parameters
# v4 GEOMETRIC - measures the wall's ACTUAL finish-layer face
# ENGINE: PythonNet3 (Dynamo 4.0's core Python engine - formerly
# named 'CPython3', renamed because it now runs on pythonnet 3.x;
# no add-on package needed, portable to any machine). The code is
# engine-neutral, so it also runs under IronPython, but the node is
# set to PythonNet3 so Dynamo 4.0 runs it natively with no engine-
# conversion prompt. (In Dynamo 4.0 the old 'CPython3' value is no
# longer supported and is auto-converted to PythonNet3 on open.)
#
# ------------------------- INPUTS ---------------------------
# IN[0] : List of Rooms (from "All Elements of Category")
# IN[1] : Wall parameter name    (string, "Wall Finish Area")
# IN[2] : Floor parameter name   (string, "Floor Finish Area")
# IN[3] : Ceiling parameter name (string, "Ceiling Finish Area")
# IN[4] : Subtract door/window openings   (bool, default True)
#         (applies only to walls measured via FALLBACK)
# IN[5] : Subtract casework voids         (bool, default True)
#         (applies only to walls measured via FALLBACK)
# IN[6] : OPTIONAL - CSV export file path (string), e.g.
#         "C:\\Temp\\FinishAreas.csv". When given, writes the
#         per-room per-material breakdown (Room Number, Room
#         Name, Surface, Material, Material Code, Is Painted,
#         Area m2) - Excel-ready, UTF-8 with BOM for Danish
#         characters. Material Code = Material's 'Code', 'Mark',
#         or 'Keynote' parameter (first non-empty).
#         'Is Painted' = Yes/No, the SAME distinction Revit's
#         Material Takeoff makes with 'Material: As Paint'.
#         Filter the CSV to Is Painted = Yes to get the paint
#         cost basis; the No rows are wall-type LAYER materials
#         (e.g. 'EM Wall', 'Default Wall') that Revit's paint
#         takeoff excludes. A 'Default Wall' row means a wall
#         layer with no material assigned - a modelling flag,
#         not a finish.
# IN[7] : OPTIONAL - Wall PAINT-area parameter name (string,
#         default "Wall Paint Area"). Room-clipped PAINTED-only
#         wall area, written to Rooms and Walls. Schedule this
#         (not 'Wall Finish Area') in a Wall Material Takeoff
#         filtered to 'Material: As Paint = Yes' to match the
#         painted CSV rows per material.
# IN[8] : OPTIONAL - Net floor-area parameter name (string,
#         default "Net Floor Area"). The building-code walkable
#         area: room footprint counted ONLY where a real floor/
#         foundation slab sits beneath it, at the slab's finished
#         top face. Area open to below (voids, atria, double-
#         height, stair openings) carries no slab and is deducted.
#         This is Revit's read-only Room.Area corrected - Room.Area
#         itself never deducts floor openings.
#
# OFFICE STANDARD (see BIM manual): one finish material per
# wall/floor/ceiling element (separate 20mm finish walls joined
# to base walls). Split Face + Paint is NOT the office standard;
# walls modeled that way will report their room-side layer/paint
# material only.
#
#
# OUT   : Report list (summary + one line per room)
#
# ------------------ HOW WALLS ARE MEASURED ------------------
# GEOMETRIC (primary): for each wall bounding the room, the
# wall's real side faces are harvested from its full solid
# geometry (see element_faces) - these are the actual surfaces
# of the outermost finish layer (e.g. 'Finish 2 [5]'), whose
# geometry ALREADY
# excludes every cut: door/window openings, casework voids
# (hosted, auto-cut, or manual Cut Geometry), reveals, edited
# profiles. That face is clipped to the room by intersecting
# it with the room's boundary subface (thin-solid boolean).
# Result: exact net finish area per wall per room, no
# deduction parameters needed.
#
# FALLBACK (automatic, per wall): if the geometric method
# fails for a wall (curved wall, linked wall, non-planar face,
# boolean failure), that wall uses the previous approach -
# planar room-subface area minus arithmetic deductions
# ('Void Area' > 'Void Width'x'Void Height' > Width x Height).
# Door/window/casework deductions are skipped for walls that
# were measured geometrically (they are already net).
#
# ---------------------- ALSO HANDLED ------------------------
#  - Auto-enables 'Areas and Volumes' so rooms stop at
#    bounding ceilings (floor finish to ceiling finish)
#  - Floor / Ceiling split via SubfaceType Bottom / Top
#  - Painted DOOR REVEALS / returns inside openings: the
#    wall-thickness jamb + head faces are perpendicular to the
#    room plane, so the boundary sweep never sees them. They are
#    measured off the host wall and reported under the 'Reveals'
#    surface, attributed to each door's FromRoom (else ToRoom),
#    and folded into Wall Finish / Wall Paint Area. Only the
#    VISIBLE return is counted: the door's own solids (lining /
#    frame / leaf) are subtracted, so the part of the reveal
#    hidden behind the frame is excluded (Revit's native takeoff
#    counts the whole painted face - this is stricter, matching
#    the actually-visible painted surface).
#  - Room Separation Line boundaries excluded
#  - Unplaced/unenclosed rooms counted into one summary line
#  - Engine-agnostic input handling (IronPython/.NET lists)
#  - Writes internal sq ft into Area-type parameters
#
# ------------------------ KNOWN LIMITS ----------------------
#  - Geometric mode measures the model as built: reveals,
#    sweep cuts, and profile edits also reduce the number.
#    If your takeoff standard counts those, review results.
#  - Extra finish INSIDE niches (jambs/head/back) not added.
#  - Curtain walls: measured as boundary faces (glazing incl).
#  - Linked-model walls fall back to arithmetic mode.
#
# RE-RUN BEFORE ISSUING DELIVERABLES - values are snapshots.
# ============================================================

import clr

clr.AddReference('RevitAPI')
from Autodesk.Revit.DB import (
    AreaVolumeSettings,
    BooleanOperationsType,
    BooleanOperationsUtils,
    BuiltInCategory,
    BuiltInParameter,
    ElementId,
    FilteredElementCollector,
    GeometryCreationUtilities,
    GeometryInstance,
    InstanceVoidCutUtils,
    Options,
    PlanarFace,
    Solid,
    SpatialElementBoundaryOptions,
    SpatialElementBoundaryLocation,
    SpatialElementGeometryCalculator,
    StorageType,
    SubfaceType,
    ViewDetailLevel,
    Wall,
    XYZ
)

clr.AddReference('RevitServices')
from RevitServices.Persistence import DocumentManager
from RevitServices.Transactions import TransactionManager

doc = DocumentManager.Instance.CurrentDBDocument

# ============================ INPUTS ============================
# Engine-agnostic normalization (IronPython may pass .NET IList,
# which fails isinstance(x, list) - so we duck-type instead).
_raw = IN[0]
if not hasattr(_raw, "__iter__") or isinstance(_raw, str):
    _raw = [_raw]
rooms = [UnwrapElement(r) for r in _raw]

wall_param_name    = IN[1] if len(IN) > 1 and IN[1] else "Wall Finish Area"
floor_param_name   = IN[2] if len(IN) > 2 and IN[2] else "Floor Finish Area"
ceiling_param_name = IN[3] if len(IN) > 3 and IN[3] else "Ceiling Finish Area"
subtract_openings  = IN[4] if len(IN) > 4 and IN[4] is not None else True
subtract_casework  = IN[5] if len(IN) > 5 and IN[5] is not None else True
use_geometric      = True   # geometric measurement is standard
auto_adjust_limits = True   # sloped-ceiling limit fix is standard
export_csv_path    = IN[6] if len(IN) > 6 and IN[6] else ""

# PAINTED-ONLY wall area (room-clipped), written to rooms AND walls.
# This is the number that makes a Revit Wall Material Takeoff match
# this engine's CSV: on a wall carrying paint over a substrate,
# 'Wall Finish Area' holds the WHOLE face (paint + EM Wall / Default
# Wall) and repeats that whole value on every material row, so
# summing it by material over-reports paint. 'Wall Paint Area' holds
# only the painted face, so a takeoff filtered to 'Material: As Paint
# = Yes' sums per material to the CSV's painted rows. Bind this as a
# NEW Area parameter to Walls (and Rooms) - it does NOT overwrite the
# existing 'Wall Finish Area', which stays = total finish face.
paint_param_name   = IN[7] if len(IN) > 7 and IN[7] else "Wall Paint Area"

# NET (walkable / building-code) floor area, written to rooms. Unlike
# Revit's Room.Area - which is the full plan footprint between the
# bounding walls and does NOT deduct floor openings - this counts only
# the footprint that sits directly over a real floor slab, measured at
# the slab's finished top face. Areas open to below (voids, atria,
# stair/double-height openings) carry no slab and are deducted. This
# is the read-only Room.Area corrected to the code-countable area.
net_floor_param_name = IN[8] if len(IN) > 8 and IN[8] else "Net Floor Area"

SCRIPT_VERSION = "v15 (PythonNet3 engine - Dynamo 4.0)"
FT2_TO_M2 = 0.09290304  # internal sq ft -> square metres for CSV

report = []
SEP_LINE_CAT_ID = ElementId(BuiltInCategory.OST_RoomSeparationLines)
CEILING_CAT_ID  = ElementId(BuiltInCategory.OST_Ceilings)
ROOF_CAT_ID     = ElementId(BuiltInCategory.OST_Roofs)
FLOOR_CAT_ID    = ElementId(BuiltInCategory.OST_Floors)
# Structural foundation slabs (slab-on-grade). The enum member is
# SINGULAR - OST_StructuralFoundation - and can vary/absent across
# API versions, so resolve it defensively: a missing name must never
# break module load. getattr returns None if it is not present.
_FOUND_BIC = getattr(BuiltInCategory, "OST_StructuralFoundation", None)
FOUNDATION_CAT_ID = ElementId(_FOUND_BIC) if _FOUND_BIC is not None else None
CEIL_SRC_ORDER  = ["ceiling", "slab above", "roof", "other"]
# Categories that count as a "floor slab underneath" for the net
# (walkable / building-code) floor area: architectural + structural
# floors, and structural foundation slabs. None entries dropped.
SLAB_CAT_IDS = tuple(c for c in (FLOOR_CAT_ID, FOUNDATION_CAT_ID)
                     if c is not None)

COPLANAR_TOL = 0.02   # ft (~6 mm) plane-matching tolerance
EXTRUDE_T    = 0.10   # ft thin-solid thickness for intersection
SCAN_BAND    = 20.0   # ft above room base to search for ceilings/roofs
LIMIT_MARGIN = 0.5    # ft raised above the highest ceiling point
# Reveal-coverage slab thickness. Deliberately THIN (~6 mm) so a door
# lining/frame sitting against the reveal fully spans it (giving the
# true covered footprint), while a leaf offset into the opening does
# not get falsely counted. Larger would under-deduct thin linings.
REVEAL_SLAB_T = 0.02  # ft (~6 mm)

# ========== PRE-FLIGHT: volume computation (AUTO-FIX) ==========
try:
    av_settings = AreaVolumeSettings.GetAreaVolumeSettings(doc)
    if not av_settings.ComputeVolumes:
        TransactionManager.Instance.EnsureInTransaction(doc)
        av_settings.ComputeVolumes = True
        doc.Regenerate()
        report.append(
            "AUTO-FIX: 'Areas and Volumes' computation was OFF and has "
            "been enabled, so rooms now stop at bounding ceilings "
            "(floor finish to ceiling finish). If a room still reports "
            "'no top boundary', its ceiling is not Room Bounding or the "
            "room's upper limit stops below it.")
except Exception as e:
    report.append("WARNING: could not verify/enable volume "
                  "computation: {}".format(str(e)))

# =================== GEOMETRY CALCULATOR SETUP ===================
opts = SpatialElementBoundaryOptions()
opts.SpatialElementBoundaryLocation = SpatialElementBoundaryLocation.Finish
calculator = SpatialElementGeometryCalculator(doc, opts)

# ============ COLLECT DEDUCTIBLE INSTANCES (fallback) ============
def collect_category(bic):
    return list(FilteredElementCollector(doc)
                .OfCategory(bic)
                .WhereElementIsNotElementType()
                .ToElements())

all_openings = []
if subtract_openings:
    all_openings = (collect_category(BuiltInCategory.OST_Doors)
                    + collect_category(BuiltInCategory.OST_Windows))

# Doors, for measuring PAINTED reveal/return surfaces INSIDE the
# opening (the wall-thickness jamb + head returns). These faces are
# perpendicular to the room-boundary plane, so the room-boundary
# sweep can never see them - yet they are painted and Revit's native
# takeoff counts them. Collected independently of the fallback
# opening-deduction list.
capture_door_reveals = True
# Deduct the portion of each reveal COVERED by the door's own geometry
# (lining / frame / leaf), so only the visible painted return is
# counted - not the full wall face. Done by subtracting the door's
# real solids from a thin slab hugging the reveal, so it adapts to
# whatever each family models. False -> report the whole painted face.
deduct_frame_coverage = True
all_doors = collect_category(BuiltInCategory.OST_Doors)

all_casework = []
if subtract_casework:
    for inst in collect_category(BuiltInCategory.OST_Casework):
        keep = False
        try:
            if isinstance(inst.Host, Wall):
                keep = True
        except Exception:
            pass
        if not keep:
            try:
                for cid in InstanceVoidCutUtils.GetElementsBeingCut(inst):
                    if isinstance(doc.GetElement(cid), Wall):
                        keep = True
                        break
            except Exception:
                pass
        if keep:
            all_casework.append(inst)

# ============ INTERIOR (MEZZANINE) SLAB COLLECTION ============
# A mezzanine is a slab INSIDE a room, not between rooms. Correct
# setup: Room Bounding UNCHECKED on the slab, so the room volume
# stays whole (full height). But a non-bounding slab never appears
# in boundary faces, so its finishes would be invisible. This pass
# collects non-bounding floors; per room, any that sit inside the
# room's volume contribute their real top faces as FLOOR finish
# (mezzanine deck) and bottom faces as CEILING finish (soffit).
interior_slabs = []
for _f in collect_category(BuiltInCategory.OST_Floors):
    try:
        _rb = _f.get_Parameter(BuiltInParameter.WALL_ATTR_ROOM_BOUNDING)
        if _rb is not None and _rb.AsInteger() == 0:
            interior_slabs.append(_f)
    except Exception:
        pass

# Non-room-bounding interior WALLS (hanging / partial-height /
# freestanding partitions inside a room). Like interior slabs,
# a non-bounding wall never appears in boundary faces, so its
# finish would be invisible. Per room, any that sit inside the
# room's volume contribute BOTH side faces as wall finish
# (a freestanding partition is finished on both sides).
interior_walls = []
for _w in collect_category(BuiltInCategory.OST_Walls):
    try:
        _rb = _w.get_Parameter(BuiltInParameter.WALL_ATTR_ROOM_BOUNDING)
        if _rb is not None and _rb.AsInteger() == 0:
            interior_walls.append(_w)
    except Exception:
        pass

# ========= AUTO-ADJUST ROOM UPPER LIMITS (sloped ceilings) =========
# Revit rule: a room's volume can NEVER rise above its Upper Limit
# + Offset - bounding ceilings only clip WITHIN that allowance. A
# sloped ceiling climbing above the limit leaves the room sliced
# flat, missing the wedge beneath the slope. Fix: raise each room's
# Upper Offset just above the highest overlapping ceiling/roof.
# Raise-only, minimal, with a small margin; the ceiling still clips
# the volume, so extra headroom is harmless.
adjusted_rooms = 0
if auto_adjust_limits:
    TransactionManager.Instance.EnsureInTransaction(doc)
    _top_candidates = []
    for c in (collect_category(BuiltInCategory.OST_Ceilings)
              + collect_category(BuiltInCategory.OST_Floors)
              + collect_category(BuiltInCategory.OST_Roofs)):
        try:
            bb = c.get_BoundingBox(None)
            if bb is not None:
                _top_candidates.append((c, bb))
        except Exception:
            pass
    for room in rooms:
        try:
            if room is None or room.Area <= 0:
                continue
            rbb = room.get_BoundingBox(None)
            if rbb is None:
                continue
            base_z = rbb.Min.Z
            # Probe Z just above the room's own base - inside the
            # room's real footprint, never inside the candidate.
            probe_z = base_z + 0.5
            needed_top = None
            for _c, bb in _top_candidates:
                # cheap reject: bbox vs bbox, before the precise
                # footprint test below
                if (bb.Max.X < rbb.Min.X or bb.Min.X > rbb.Max.X
                        or bb.Max.Y < rbb.Min.Y or bb.Min.Y > rbb.Max.Y):
                    continue
                # only elements starting clearly ABOVE this room's
                # base (excludes the room's own floor slab) and
                # within a sane band (avoids grabbing storeys far
                # above and ballooning the room upward)
                if (bb.Min.Z < base_z + 1.0
                        or bb.Min.Z > base_z + SCAN_BAND):
                    continue
                # REAL footprint overlap: bbox-vs-bbox alone is not
                # enough - an L-shaped/offset room's rectangular bbox,
                # or a small dormer/monitor sitting near one corner,
                # can share bounding rectangles without the two shapes
                # ever actually touching. Sample the candidate's own
                # footprint corners (+ centre) against the room's true
                # (possibly concave) boundary; only a genuine hit may
                # raise the room's limit into that element's airspace -
                # otherwise an unrelated dormer/roof feature drags the
                # room volume (and later, its own faces) into a room
                # it never actually bounds.
                _pts = (
                    XYZ(bb.Min.X, bb.Min.Y, probe_z),
                    XYZ(bb.Max.X, bb.Min.Y, probe_z),
                    XYZ(bb.Min.X, bb.Max.Y, probe_z),
                    XYZ(bb.Max.X, bb.Max.Y, probe_z),
                    XYZ((bb.Min.X + bb.Max.X) / 2.0,
                        (bb.Min.Y + bb.Max.Y) / 2.0, probe_z),
                )
                _hit = False
                for _pt in _pts:
                    try:
                        if room.IsPointInRoom(_pt):
                            _hit = True
                            break
                    except Exception:
                        continue
                if not _hit:
                    continue
                t = bb.Max.Z + LIMIT_MARGIN
                if needed_top is None or t > needed_top:
                    needed_top = t
            if needed_top is None:
                continue
            if rbb.Max.Z >= needed_top - (LIMIT_MARGIN * 0.5):
                continue  # room already reaches high enough
            p = room.get_Parameter(BuiltInParameter.ROOM_UPPER_OFFSET)
            if p is None or p.IsReadOnly:
                continue
            ref_z = base_z
            try:
                if room.UpperLimit is not None:
                    ref_z = room.UpperLimit.Elevation
            except Exception:
                pass
            new_off = needed_top - ref_z
            if new_off > p.AsDouble():
                p.Set(new_off)
                adjusted_rooms += 1
        except Exception:
            continue
    if adjusted_rooms > 0:
        doc.Regenerate()  # rebuild room volumes BEFORE measuring
        report.append(
            "AUTO-ADJUST: raised the upper limit of {} room(s) so "
            "sloped ceilings/roofs now bound the full room volume "
            "(raise-only, highest overlapping ceiling + margin)."
            .format(adjusted_rooms))

# ==================== FALLBACK DEDUCTION SIZE ====================
def opening_area(inst):
    """Deduction size, internal sq ft. Priority (instance then type):
    1. 'Void Area'  2. 'Void Width' x 'Void Height'
    3. built-in family Width x Height  4. 'Width' x 'Height'."""
    holders = [inst]
    try:
        t = doc.GetElement(inst.GetTypeId())
        if t is not None:
            holders.append(t)
    except Exception:
        pass
    for holder in holders:
        va = holder.LookupParameter("Void Area")
        if (va and va.HasValue
                and va.StorageType == StorageType.Double
                and va.AsDouble() > 0):
            return va.AsDouble()
    for holder in holders:
        vw = holder.LookupParameter("Void Width")
        vh = holder.LookupParameter("Void Height")
        if (vw and vh and vw.HasValue and vh.HasValue
                and vw.StorageType == StorageType.Double
                and vh.StorageType == StorageType.Double):
            return vw.AsDouble() * vh.AsDouble()
    for holder in holders:
        w = holder.get_Parameter(BuiltInParameter.FAMILY_WIDTH_PARAM)
        h = holder.get_Parameter(BuiltInParameter.FAMILY_HEIGHT_PARAM)
        if w and h and w.HasValue and h.HasValue:
            return w.AsDouble() * h.AsDouble()
        w = holder.LookupParameter("Width")
        h = holder.LookupParameter("Height")
        if (w and h and w.HasValue and h.HasValue
                and w.StorageType == StorageType.Double
                and h.StorageType == StorageType.Double):
            return w.AsDouble() * h.AsDouble()
    return 0.0

def get_room_phase(room):
    try:
        p = room.get_Parameter(BuiltInParameter.ROOM_PHASE)
        if p:
            return doc.GetElement(p.AsElementId())
    except Exception:
        pass
    return None

def door_window_deduction(room, phase, exact_wall_ids):
    """Openings in FALLBACK-measured walls only - geometric walls
    already have openings removed in their face geometry."""
    total, count = 0.0, 0
    for inst in all_openings:
        try:
            host = inst.Host
            if (host is not None and isinstance(host, Wall)
                    and host.Id in exact_wall_ids):
                continue  # already net in geometric measurement
            fr = inst.get_FromRoom(phase) if phase else inst.FromRoom
            tr = inst.get_ToRoom(phase) if phase else inst.ToRoom
        except Exception:
            continue
        if (fr is not None and fr.Id == room.Id) or \
           (tr is not None and tr.Id == room.Id):
            a = opening_area(inst)
            if a > 0:
                total += a
                count += 1
    return total, count

def casework_deduction(room, phase, exact_wall_ids):
    """Casework voids in FALLBACK-measured walls only."""
    total, count = 0.0, 0
    for inst in all_casework:
        try:
            r = inst.get_Room(phase) if phase else inst.Room
        except Exception:
            continue
        if r is None or r.Id != room.Id:
            continue
        cut_geometric = False
        try:
            host = inst.Host
            if (host is not None and isinstance(host, Wall)
                    and host.Id in exact_wall_ids):
                cut_geometric = True
            if not cut_geometric:
                for cid in InstanceVoidCutUtils.GetElementsBeingCut(inst):
                    if cid in exact_wall_ids:
                        cut_geometric = True
                        break
        except Exception:
            pass
        if cut_geometric:
            continue  # void already carved out of the measured face
        a = opening_area(inst)
        if a > 0:
            total += a
            count += 1
    return total, count

# ================= GEOMETRIC WALL MEASUREMENT ====================
def planar_data(face):
    try:
        if isinstance(face, PlanarFace):
            return face.Origin, face.FaceNormal.Normalize()
    except Exception:
        pass
    return None, None

def element_faces(elem):
    """EVERY face of the element's built geometry. Required instead
    of HostObjectUtils.GetSideFaces/GetTopFaces because those can
    return one reference per side, COLLAPSING Split Face regions -
    each split region is its own Face carrying its own (painted)
    material, and only full-geometry harvesting preserves them.
    Downstream, exact_subface_area's coplanarity filter selects the
    room-facing faces, so harvesting everything is safe.
    Stacked walls: parent geometry can be empty, so member walls
    are harvested individually."""
    faces = []
    elems = [elem]
    try:
        if isinstance(elem, Wall) and elem.IsStackedWall:
            elems = [doc.GetElement(i)
                     for i in elem.GetStackedWallMemberIds()]
    except Exception:
        pass
    opt = Options()
    opt.IncludeNonVisibleObjects = False
    opt.DetailLevel = ViewDetailLevel.Fine  # never coarsen regions
    # REQUIRED for paint detection: Document.IsPainted resolves a
    # face through its Reference, which Revit only populates when
    # ComputeReferences is True. Without it every IsPainted call
    # fails and every face silently reports as unpainted, which
    # would collapse the paint/layer split this script exists to
    # produce. Do not turn this off.
    opt.ComputeReferences = True
    for e in elems:
        if e is None:
            continue
        try:
            geo = e.get_Geometry(opt)
            if geo is None:
                continue
            for obj in geo:
                try:
                    for f in obj.Faces:
                        faces.append(f)
                except Exception:
                    continue
        except Exception:
            continue
    return faces

def wall_side_faces(wall):
    """All wall faces; coplanarity filtering picks the room side."""
    return element_faces(wall)

def _directional_faces(elem, want_up):
    """Planar faces pointing up (top finishes) or down (undersides),
    from full geometry so Split Face regions survive. Used for
    mezzanine slabs where whole faces are summed without clipping."""
    out = []
    for f in element_faces(elem):
        _o, _n = planar_data(f)
        if _o is None:
            continue
        if want_up and _n.Z > 0.5:
            out.append(f)
        elif (not want_up) and _n.Z < -0.5:
            out.append(f)
    return out

def host_top_faces(elem):
    return _directional_faces(elem, True)

def host_bottom_faces(elem):
    return _directional_faces(elem, False)

def exact_subface_area(subface, host_faces, owner=None):
    """Net finish area within this room: intersect the room's
    boundary subface with the host's coplanar real face(s), whose
    geometry already excludes every cut. Each host face knows its
    material, so the result is keyed per material - a stacked or
    split-region wall (tiles below, paint above) yields separate
    entries per finish.
    Returns (total_area, {materialId: area}) in sq ft, or None if
    the method cannot apply."""
    room_face = subface.GetSubface()
    r_origin, r_normal = planar_data(room_face)
    if r_origin is None:
        return None
    total = 0.0
    mats = {}
    matched = False
    for hf in host_faces:
        h_origin, h_normal = planar_data(hf)
        if h_origin is None:
            continue
        # same plane? (normals parallel/antiparallel + zero offset)
        if abs(abs(r_normal.DotProduct(h_normal)) - 1.0) > 0.01:
            continue
        if abs((h_origin - r_origin).DotProduct(r_normal)) > COPLANAR_TOL:
            continue
        matched = True
        try:
            s_room = GeometryCreationUtilities.CreateExtrusionGeometry(
                room_face.GetEdgesAsCurveLoops(), r_normal, EXTRUDE_T)
            s_host = GeometryCreationUtilities.CreateExtrusionGeometry(
                hf.GetEdgesAsCurveLoops(), r_normal, EXTRUDE_T)
            inter = BooleanOperationsUtils.ExecuteBooleanOperation(
                s_room, s_host, BooleanOperationsType.Intersect)
            if inter is not None and inter.Volume > 1e-9:
                a = inter.Volume / EXTRUDE_T
                total += a
                mkey = face_material_key(owner, hf)
                mats[mkey] = mats.get(mkey, 0.0) + a
        except Exception:
            return None  # any boolean failure -> fall back entirely
    # A coplanar face matched but the intersection came back (near-)
    # empty: that is a silent geometric failure (winding/orientation
    # quirks can yield an empty boolean without throwing), NOT a real
    # "zero finish area". Return None so the planar fallback engages
    # and the report's fallback note discloses it - never let a
    # failed measurement masquerade as a confident 0.
    if not matched or total <= 1e-6:
        return None
    return (total, mats)

def clip_face_to_solid(face, solid, thickness=EXTRUDE_T):
    """Area of `face` that actually lies inside `solid` (here always a
    room's own SpatialElementGeometryCalculator result - the room's
    REAL, already-clipped volume), via thin-solid boolean intersection.

    Used for NON-room-bounding elements (interior/mezzanine slabs,
    freestanding walls) whose faces are gathered by a coarse bounding-
    box / point-in-room pre-filter. That pre-filter only proves the
    element is SOMEWHERE near the room - not that the whole face lies
    inside it. Without this clip, an element that only partly overlaps
    the room (a slab or partition that continues past the room's real
    boundary into a neighbouring space, a stairwell, or a non-bounding
    dormer/monitor volume whose footprint only grazes the room) has its
    FULL face area misattributed to this one room - exactly the
    "painted area outside the room boundary" leak.

    Straddles the face symmetrically (+/- thickness/2 along its own
    normal) so the clip is correct regardless of which way the face
    happens to point.

    Returns the clipped area in sq ft, 0.0 if the face does not
    overlap the room at all, or None if the boolean operation itself
    failed (caller should skip the face rather than trust a partial
    result)."""
    _o, _n = planar_data(face)
    if _o is None:
        return None
    try:
        loops = face.GetEdgesAsCurveLoops()
        slab_pos = GeometryCreationUtilities.CreateExtrusionGeometry(
            loops, _n, thickness / 2.0)
        slab_neg = GeometryCreationUtilities.CreateExtrusionGeometry(
            loops, _n, -thickness / 2.0)
        slab = BooleanOperationsUtils.ExecuteBooleanOperation(
            slab_pos, slab_neg, BooleanOperationsType.Union)
        inter = BooleanOperationsUtils.ExecuteBooleanOperation(
            slab, solid, BooleanOperationsType.Intersect)
    except Exception:
        return None
    if inter is None or inter.Volume <= 1e-9:
        return 0.0
    area = inter.Volume / thickness
    full = face.Area
    return area if area < full else full

# ========================== UTILITIES ============================
def boundary_element(subface):
    try:
        return doc.GetElement(subface.SpatialBoundaryElement.HostElementId)
    except Exception:
        return None

def set_area(r, pname, value):
    p = r.LookupParameter(pname)
    if p and not p.IsReadOnly:
        p.Set(value)
        return True
    return False

def room_label(room):
    try:
        num = room.get_Parameter(BuiltInParameter.ROOM_NUMBER)
        name = room.get_Parameter(BuiltInParameter.ROOM_NAME)
        return "{} {}".format(
            num.AsString() if num else "",
            name.AsString() if name else "").strip() or str(room.Id)
    except Exception:
        return str(room.Id)

def split_key(mkey):
    """(material, is_painted) from a material key, tolerant of a
    bare material passed by mistake (treated as unpainted)."""
    try:
        mid, painted = mkey
        return (mid, bool(painted))
    except Exception:
        return (mkey, False)

def material_info(mkey):
    """(name, code, is_painted) for a material key. A key is the
    tuple (material, is_painted), where material is either an
    ElementId from Face.MaterialElementId or a descriptive string
    like '(fallback)'. Code = first non-empty of the Material's
    'Code', 'Mark', or 'Keynote' parameter (office codes like
    VBJ/VBF). is_painted carries Document.IsPainted through to the
    output so paint can be costed apart from layer materials."""
    mid, painted = split_key(mkey)
    if isinstance(mid, str):
        return (mid, "", painted)
    try:
        m = doc.GetElement(mid) if mid is not None else None
        if m is None:
            return ("(no material)", "", painted)
        name = m.Name
        code = ""
        for pname in ("Code", "Mark", "Keynote"):
            p = m.LookupParameter(pname)
            if p and p.HasValue:
                v = p.AsString()
                if v:
                    code = v
                    break
        return (name, code, painted)
    except Exception:
        return ("(no material)", "", painted)

# (roomNum, roomName, surface, matName, matCode, isPainted, m2)
csv_rows = []

# Keys for area that belongs to no identifiable face material.
# Never painted by definition: arithmetic fallback area is not
# measured off a face at all, so it carries no paint status.
FALLBACK_KEY = ("(fallback)", False)

def face_material_key(owner, f):
    """Material key for a face: (material, is_painted).

    Document.IsPainted positively identifies painted faces (Split
    Face regions the user painted), whose MaterialElementId then
    reports the PAINT material. Unpainted faces report their wall-
    type LAYER material instead ('EM Wall', 'Default Wall', ...) -
    the same material Revit shows in a Material Takeoff, and the
    same material Revit's paint takeoff EXCLUDES when filtered on
    'Material: As Paint = Yes'.

    Both cases resolve to a MaterialElementId, so the id alone
    cannot tell paint from substrate. The flag is what makes the
    two reconcilable: painted rows are the paint cost basis,
    unpainted rows are substrate that must not be paint-costed
    (or are missing paint in the model - a modelling flag).

    NOTE: IsPainted needs face References, so the geometry must be
    harvested with Options.ComputeReferences = True (element_faces
    does this). Without it every face reads as unpainted."""
    painted = False
    try:
        if owner is not None and doc.IsPainted(owner.Id, f):
            painted = True
    except Exception:
        painted = False
    try:
        mid = f.MaterialElementId
    except Exception:
        return ("(no material)", painted)
    try:
        if mid is None or mid == ElementId.InvalidElementId:
            return ("(no material)", painted)
    except Exception:
        pass
    return (mid, painted)

# ============ DOOR-REVEAL (OPENING RETURN) PAINT =================
# The room-boundary sweep only matches wall faces COPLANAR with the
# room plane, so the wall-thickness returns inside a door opening
# (two jambs + head) are never seen - their normals are ~perpendicular
# to the room face. They are real painted surfaces that Revit's native
# takeoff counts. This pass measures them directly off the host wall's
# geometry and attributes each opening's reveal paint to ONE room, so
# the model-wide total matches Revit without double-counting.

# element_faces() re-extracts solid geometry each call; cache per wall
# so a wall hosting several doors (and already swept for its room face)
# is harvested once.
_wall_faces_cache = {}
def wall_faces_cached(wall):
    try:
        wid = wall.Id
    except Exception:
        return element_faces(wall)
    key = wid.IntegerValue if hasattr(wid, "IntegerValue") else wid
    fs = _wall_faces_cache.get(key)
    if fs is None:
        fs = element_faces(wall)
        _wall_faces_cache[key] = fs
    return fs

def _face_centroid(f):
    """A representative world point on the face, averaged from its
    edge vertices (robust for planar reveal faces)."""
    try:
        pts = []
        for loop in f.GetEdgesAsCurveLoops():
            for c in loop:
                pts.append(c.GetEndPoint(0))
        n = len(pts)
        if n == 0:
            return None
        sx = sum(p.X for p in pts) / n
        sy = sum(p.Y for p in pts) / n
        sz = sum(p.Z for p in pts) / n
        return XYZ(sx, sy, sz)
    except Exception:
        return None

def _pt_in_bbox(pt, bb, pad):
    if pt is None or bb is None:
        return False
    return (bb.Min.X - pad <= pt.X <= bb.Max.X + pad and
            bb.Min.Y - pad <= pt.Y <= bb.Max.Y + pad and
            bb.Min.Z - pad <= pt.Z <= bb.Max.Z + pad)

REVEAL_PAD = 0.05  # ft tolerance around the door bbox

_door_solids_cache = {}
def _collect_solids(gobj, out):
    """Flatten a door's GeometryElement to world-coordinate solids,
    descending through the family's GeometryInstances."""
    try:
        if isinstance(gobj, Solid):
            if gobj.Volume > 1e-9 and gobj.Faces.Size > 0:
                out.append(gobj)
        elif isinstance(gobj, GeometryInstance):
            for g2 in gobj.GetInstanceGeometry():
                _collect_solids(g2, out)
    except Exception:
        pass

def door_solids(door):
    """Real solids of the door instance (lining, frame, leaf, glass),
    cached per door."""
    try:
        did = door.Id
        key = did.IntegerValue if hasattr(did, "IntegerValue") else did
    except Exception:
        key = None
    if key is not None and key in _door_solids_cache:
        return _door_solids_cache[key]
    solids = []
    try:
        opt = Options()
        opt.ComputeReferences = False
        opt.IncludeNonVisibleObjects = False
        opt.DetailLevel = ViewDetailLevel.Fine
        geo = door.get_Geometry(opt)
        if geo is not None:
            for g in geo:
                _collect_solids(g, solids)
    except Exception:
        pass
    if key is not None:
        _door_solids_cache[key] = solids
    return solids

def visible_reveal_area(face, fnormal, fcentroid, door_c, solids):
    """Area of a reveal face NOT covered by the door's own geometry.

    Extrude the face into the opening as a THIN slab (toward the door
    centre), then subtract the door solids: the lining/frame that sits
    against the reveal carves out its covered footprint, leaving the
    visible painted return. Any boolean failure returns the full face
    area (never over-deducts)."""
    full = face.Area
    if not solids:
        return full
    try:
        # Extrude toward the door interior so the slab overlaps the
        # lining that sits against the reveal.
        sign = 1.0
        try:
            if (door_c - fcentroid).DotProduct(fnormal) < 0:
                sign = -1.0
        except Exception:
            sign = 1.0
        slab = GeometryCreationUtilities.CreateExtrusionGeometry(
            face.GetEdgesAsCurveLoops(), fnormal, REVEAL_SLAB_T * sign)
    except Exception:
        return full
    for sd in solids:
        try:
            diff = BooleanOperationsUtils.ExecuteBooleanOperation(
                slab, sd, BooleanOperationsType.Difference)
            if diff is not None:
                slab = diff
        except Exception:
            continue
    try:
        vis = slab.Volume / REVEAL_SLAB_T
    except Exception:
        return full
    # Clamp to [0, full]: booleans can leave slivers.
    if vis < 0:
        return 0.0
    if vis > full:
        return full
    return vis

def door_reveal_paint(host_wall, door):
    """{(material,is_painted): area} for the host wall's PAINTED faces
    that bound this door's opening (jamb + head returns).

    A reveal face is (a) NOT parallel to the wall's room faces - its
    normal is roughly perpendicular to Wall.Orientation, so it is
    neither of the two big room planes; (b) painted; and (c) sitting
    inside the door's world bounding box. Only painted faces are
    collected - this pass exists to capture paint, and Wall.Orientation
    cleanly separates returns from the room faces the main sweep
    already measured, so there is no double counting."""
    out = {}
    try:
        wtx = host_wall.Orientation.Normalize()
    except Exception:
        return out
    dbb = door.get_BoundingBox(None)
    if dbb is None:
        return out
    door_c = None
    try:
        door_c = XYZ((dbb.Min.X + dbb.Max.X) / 2.0,
                     (dbb.Min.Y + dbb.Max.Y) / 2.0,
                     (dbb.Min.Z + dbb.Max.Z) / 2.0)
    except Exception:
        door_c = None
    solids = door_solids(door) if deduct_frame_coverage else []
    for f in wall_faces_cached(host_wall):
        o, n = planar_data(f)
        if o is None:
            continue
        # Skip the two room-facing planes (normal parallel to wall
        # orientation) - those are the main sweep's territory.
        if abs(n.DotProduct(wtx)) > 0.5:
            continue
        try:
            if not doc.IsPainted(host_wall.Id, f):
                continue
        except Exception:
            continue
        _fc = _face_centroid(f)
        if not _pt_in_bbox(_fc, dbb, REVEAL_PAD):
            continue
        # Only the return NOT hidden behind the door's lining/frame.
        if deduct_frame_coverage and solids and door_c is not None:
            area = visible_reveal_area(f, n, _fc, door_c, solids)
        else:
            area = f.Area
        if area <= 0.005:
            continue
        mkey = face_material_key(host_wall, f)
        out[mkey] = out.get(mkey, 0.0) + area
    return out

# Per-ELEMENT finish totals, for wall/floor/ceiling schedules.
# Accumulated during measurement (a wall between two rooms sums
# both room-side contributions), written after the main loop onto
# any element that carries the same-named parameter.
elem_wall_area    = {}   # wall ElementId    -> sq ft (whole finish face)
elem_wall_paint   = {}   # wall ElementId    -> sq ft (PAINTED face only)
elem_floor_area   = {}   # floor ElementId   -> sq ft (top finish)
elem_ceiling_area = {}   # host ElementId    -> sq ft (underside)
def _acc(d, eid, val):
    if eid is None or val <= 0:
        return
    d[eid] = d.get(eid, 0.0) + val

def _painted_of(mats):
    """Sum of the PAINTED areas in a {(material,is_painted): area}
    dict. Unpainted layer/substrate faces (EM Wall, Default Wall,
    fallback) are excluded, so this is the paint cost basis."""
    _t = 0.0
    for _k, _v in mats.items():
        if split_key(_k)[1]:
            _t += _v
    return _t

def _id_str(eid):
    """ElementId -> its integer as a string, across API versions
    (Revit 2024+ renamed ElementId.IntegerValue to .Value)."""
    try:
        return str(eid.Value)
    except Exception:
        pass
    try:
        return str(eid.IntegerValue)
    except Exception:
        return str(eid)

def _painted_mat_count(mats):
    """How many DISTINCT painted materials a face set carries. >1
    means a wall with two paint colours on one face (split-face);
    such a wall's single per-element paint value would repeat on
    both paint rows of a takeoff and double-count - flagged for QC."""
    _s = set()
    for _k, _v in mats.items():
        if split_key(_k)[1] and _v > 0.005:
            _s.add(split_key(_k)[0])
    return len(_s)

# Walls carrying >1 paint colour on their room face - a takeoff on
# 'Wall Paint Area' would double-count these. Collected for the QC
# report so they can be handled by hand (rare under the one-finish-
# per-wall office standard).
multipaint_wall_ids = set()

# ========================== MAIN LOOP ============================
TransactionManager.Instance.EnsureInTransaction(doc)

processed_count = 0
skipped_unplaced = 0

for room in rooms:
    try:
        if room is None or room.Area <= 0:
            skipped_unplaced += 1
            continue
        if not SpatialElementGeometryCalculator.CanCalculateGeometry(room):
            report.append("Skipped (geometry not computable): {}".format(
                room_label(room)))
            continue
    except Exception:
        report.append("Skipped (invalid element)")
        continue

    wall_exact   = 0.0   # geometric (already net of every cut)
    gross_wall   = 0.0   # fallback (planar subface, needs deductions)
    floor_area   = 0.0
    ceiling_area = 0.0
    virtual_side = 0.0
    exact_wall_ids = set()
    exact_faces, fallback_faces = 0, 0
    floor_geo, floor_fb = 0, 0
    ceil_geo, ceil_fb = 0, 0
    net_floor_slab = 0.0   # footprint over a real slab (walkable area)
    room_footprint = 0.0   # full bottom-boundary area (incl. open-below)
    open_below     = 0.0   # bottom footprint with NO slab under it
    room_mats = {}  # (surface, materialKey) -> area sq ft

    def _add_mats(surface, mats):
        for k, v in mats.items():
            key = (surface, k)
            room_mats[key] = room_mats.get(key, 0.0) + v
    # Which element served as the "ceiling" (Danish priority chain:
    # Ceiling > slab above > roof) - Revit's clipping picks the
    # nearest bounding element; we RECORD which one it was so the
    # source of every ceiling area is auditable per room.
    ceil_src = {"ceiling": 0.0, "slab above": 0.0,
                "roof": 0.0, "other": 0.0}

    def _ceil_source_key(elem):
        try:
            cid = elem.Category.Id if (elem is not None
                                       and elem.Category) else None
        except Exception:
            cid = None
        if cid == CEILING_CAT_ID:
            return "ceiling"
        if cid == FLOOR_CAT_ID:
            return "slab above"
        if cid == ROOF_CAT_ID:
            return "roof"
        return "other"

    try:
        results = calculator.CalculateSpatialElementGeometry(room)
        room_solid = results.GetGeometry()

        for face in room_solid.Faces:
            for subface in results.GetBoundaryFaceInfo(face):
                area = subface.GetSubface().Area  # internal sq ft
                stype = subface.SubfaceType

                if stype == SubfaceType.Bottom:
                    # FLOOR: measure the floor's real top finish face
                    # (voids/openings already absent), clipped to room.
                    # A bottom subface exists across the WHOLE room
                    # footprint - including area that is open to below.
                    # Only footprint backed by a real floor/foundation
                    # slab counts as net (walkable) floor area; the rest
                    # is a floor void and is deducted.
                    elem = boundary_element(subface)
                    room_footprint += area
                    _has_slab = False
                    try:
                        _has_slab = (elem is not None
                                     and elem.Category is not None
                                     and elem.Category.Id in SLAB_CAT_IDS)
                    except Exception:
                        _has_slab = False
                    res = None
                    if use_geometric and _has_slab:
                        res = exact_subface_area(
                            subface, host_top_faces(elem), elem)
                    _fid = elem.Id if _has_slab else None
                    if res is not None:
                        # Geometric result is already clipped to the
                        # slab's real top face, so any open-to-below
                        # part of this subface is excluded here too.
                        floor_area += res[0]
                        net_floor_slab += res[0]
                        _add_mats("Floor", res[1])
                        _acc(elem_floor_area, _fid, res[0])
                        floor_geo += 1
                    elif _has_slab:
                        # A real slab backs this subface but the boolean
                        # clip failed (curved/edited slab). The slab
                        # exists, so its planar footprint still counts.
                        floor_area += area
                        net_floor_slab += area
                        _add_mats("Floor", {FALLBACK_KEY: area})
                        _acc(elem_floor_area, _fid, area)
                        floor_fb += 1
                    else:
                        # OPEN TO BELOW: no floor/foundation slab under
                        # this footprint -> not walkable, not floor
                        # finish. Deducted from the net floor area.
                        open_below += area
                    continue
                if stype == SubfaceType.Top:
                    # CEILING: the bounding element's real bottom
                    # finish face, clipped to room. Works for Ceiling
                    # elements, slab-above undersides, and roofs.
                    elem = boundary_element(subface)
                    res = None
                    if use_geometric and elem is not None:
                        res = exact_subface_area(
                            subface, host_bottom_faces(elem), elem)
                    _cid2 = elem.Id if elem is not None else None
                    if res is not None:
                        amt = res[0]
                        _add_mats("Ceiling", res[1])
                        ceil_geo += 1
                    else:
                        amt = area
                        _add_mats("Ceiling", {FALLBACK_KEY: area})
                        ceil_fb += 1
                    ceiling_area += amt
                    ceil_src[_ceil_source_key(elem)] += amt
                    _acc(elem_ceiling_area, _cid2, amt)
                    continue
                if stype != SubfaceType.Side:
                    continue

                elem = boundary_element(subface)
                if elem is None or (elem.Category is not None
                        and elem.Category.Id == SEP_LINE_CAT_ID):
                    virtual_side += area
                    continue

                # Steeply sloped ceilings/roofs can classify as Side
                # subfaces - route them to the CEILING bucket so they
                # never leak into the wall total.
                _cat = elem.Category.Id if elem.Category else None
                if _cat == CEILING_CAT_ID or _cat == ROOF_CAT_ID:
                    res = None
                    if use_geometric:
                        res = exact_subface_area(
                            subface, host_bottom_faces(elem), elem)
                    if res is not None:
                        amt = res[0]
                        _add_mats("Ceiling", res[1])
                        ceil_geo += 1
                    else:
                        amt = area
                        _add_mats("Ceiling", {FALLBACK_KEY: area})
                        ceil_fb += 1
                    ceiling_area += amt
                    ceil_src[_ceil_source_key(elem)] += amt
                    _acc(elem_ceiling_area, elem.Id, amt)
                    continue

                res = None
                if use_geometric and isinstance(elem, Wall):
                    res = exact_subface_area(
                        subface, wall_side_faces(elem), elem)

                if res is not None:
                    wall_exact += res[0]
                    _add_mats("Walls", res[1])
                    _acc(elem_wall_area, elem.Id, res[0])
                    _acc(elem_wall_paint, elem.Id, _painted_of(res[1]))
                    if _painted_mat_count(res[1]) > 1:
                        multipaint_wall_ids.add(elem.Id)
                    exact_wall_ids.add(elem.Id)
                    exact_faces += 1
                else:
                    # Fallback = arithmetic planar area, no paint
                    # resolution, so it feeds the total finish face
                    # only - never the painted (cost) parameter.
                    gross_wall += area
                    _acc(elem_wall_area, elem.Id, area)
                    fallback_faces += 1

    except Exception as e:
        report.append("FAILED {}: {}".format(room_label(room), str(e)))
        continue

    # ---- Arithmetic deductions for FALLBACK walls only ----
    phase = get_room_phase(room)

    open_total, open_count = (0.0, 0)
    if subtract_openings and fallback_faces > 0:
        open_total, open_count = door_window_deduction(
            room, phase, exact_wall_ids)

    cw_total, cw_count = (0.0, 0)
    if subtract_casework and fallback_faces > 0:
        cw_total, cw_count = casework_deduction(
            room, phase, exact_wall_ids)

    # ---- Interior (mezzanine) slabs inside this room's volume ----
    # Probe a point just above the slab's top (or below its bottom):
    # if that air belongs to this room, the slab lives inside it.
    # Real faces are summed, so voids/stair openings in the slab
    # are already excluded from both contributions.
    mezz_floor, mezz_ceil, mezz_count = 0.0, 0.0, 0
    for slab in interior_slabs:
        try:
            bb = slab.get_BoundingBox(None)
            if bb is None:
                continue
            cx = (bb.Min.X + bb.Max.X) / 2.0
            cy = (bb.Min.Y + bb.Max.Y) / 2.0
            inside = False
            try:
                inside = room.IsPointInRoom(
                    XYZ(cx, cy, bb.Max.Z + 0.3))
            except Exception:
                pass
            if not inside:
                try:
                    inside = room.IsPointInRoom(
                        XYZ(cx, cy, bb.Min.Z - 0.3))
                except Exception:
                    pass
            if not inside:
                continue  # cheap pre-filter: nowhere near this room
            # Clip each face to the room's REAL computed volume -
            # a non-bounding slab (mezzanine deck) can continue past
            # this room's boundary into a stairwell, a neighbouring
            # room, or open-to-below space. Taking the whole face
            # (old behaviour) over-reports whatever portion sits
            # outside the room; clip_face_to_solid keeps only the
            # part actually inside room_solid.
            top_a = 0.0
            for f in host_top_faces(slab):
                a = clip_face_to_solid(f, room_solid)
                if not a:
                    continue  # None (boolean failed) or 0 (outside)
                top_a += a
                _mk2 = face_material_key(slab, f)
                _add_mats("Floor", {_mk2: a})
            bot_a = 0.0
            for f in host_bottom_faces(slab):
                a = clip_face_to_solid(f, room_solid)
                if not a:
                    continue
                bot_a += a
                _mk2 = face_material_key(slab, f)
                _add_mats("Ceiling", {_mk2: a})
            if top_a > 0 or bot_a > 0:
                mezz_floor += top_a
                mezz_ceil += bot_a
                mezz_count += 1
                _acc(elem_floor_area, slab.Id, top_a)
                _acc(elem_ceiling_area, slab.Id, bot_a)
        except Exception:
            continue
    floor_area += mezz_floor
    ceiling_area += mezz_ceil

    # ---- Interior (hanging/freestanding) walls inside this room ----
    # Probe the wall's midpoint; if it belongs to this room, add both
    # side faces (vertical faces) as wall finish. Voids/openings are
    # already absent from the real faces. Paint-aware per face.
    hangw_area, hangw_count = 0.0, 0
    for hw in interior_walls:
        try:
            bb = hw.get_BoundingBox(None)
            if bb is None:
                continue
            cx = (bb.Min.X + bb.Max.X) / 2.0
            cy = (bb.Min.Y + bb.Max.Y) / 2.0
            cz = (bb.Min.Z + bb.Max.Z) / 2.0
            inside = False
            try:
                inside = room.IsPointInRoom(XYZ(cx, cy, cz))
            except Exception:
                pass
            if not inside:
                continue
            # Collect vertical (side) faces; prefer PAINTED faces
            # only - a hanging wall / bulkhead is usually finished
            # on the visible side(s) only, its back concealed behind
            # casework. Counting both sides doubles the quantity.
            _side_faces = []
            for f in element_faces(hw):
                _o, _n = planar_data(f)
                if _o is None or abs(_n.Z) > 0.5:
                    continue  # skip non-vertical faces
                _side_faces.append((f, _n))
            _painted_faces = []
            for f, _n in _side_faces:
                try:
                    if doc.IsPainted(hw.Id, f):
                        _painted_faces.append((f, _n))
                except Exception:
                    pass
            # If any face is painted, count ONLY painted faces.
            # If none is painted, fall back to the single face whose
            # normal points most toward the room center (the visible
            # side), never both - avoids doubling on unpainted walls.
            if _painted_faces:
                _use_faces = [f for f, _n in _painted_faces]
            elif _side_faces:
                try:
                    _rc = room.Location.Point
                except Exception:
                    _rc = None
                if _rc is not None:
                    _best, _bestdot = None, -2.0
                    for f, _n in _side_faces:
                        _fo, _fn = planar_data(f)
                        _dir = (_rc - _fo)
                        _dl = _dir.GetLength()
                        if _dl < 1e-9:
                            continue
                        _d = _fn.DotProduct(_dir.Normalize())
                        if _d > _bestdot:
                            _bestdot, _best = _d, f
                    _use_faces = [_best] if _best is not None else []
                else:
                    # no room point: take one face only (first)
                    _use_faces = [_side_faces[0][0]]
            else:
                _use_faces = []
            # Clip each face to the room's REAL computed volume - a
            # non-bounding wall can extend past this room's boundary
            # (past a corner, into an adjacent room, or outside the
            # building envelope entirely). Taking the whole face (old
            # behaviour) over-reports whatever portion sits outside
            # the room; clip_face_to_solid keeps only the part
            # actually inside room_solid.
            _wf_area = 0.0
            for f in _use_faces:
                _a = clip_face_to_solid(f, room_solid)
                if not _a:
                    continue  # None (boolean failed) or 0 (outside room)
                _wf_area += _a
                _mk3 = face_material_key(hw, f)
                _add_mats("Walls", {_mk3: _a})
                _acc(elem_wall_area, hw.Id, _a)
                if split_key(_mk3)[1]:
                    _acc(elem_wall_paint, hw.Id, _a)
            if _wf_area > 0:
                hangw_area += _wf_area
                hangw_count += 1
        except Exception:
            continue

    # ---- Painted door reveals / returns inside openings ----
    # The wall-thickness returns (jambs + head) around each door are
    # perpendicular to the room plane, so the boundary sweep misses
    # them. Measure them off the host wall and attribute each door's
    # reveal to ONE room - its FromRoom, else ToRoom - so the model
    # total matches Revit's native takeoff with no double counting.
    reveal_paint, reveal_count = 0.0, 0
    if capture_door_reveals:
        for _dr in all_doors:
            try:
                _host = _dr.Host
                if not isinstance(_host, Wall):
                    continue
                _fr = _dr.get_FromRoom(phase) if phase else _dr.FromRoom
                _tr = _dr.get_ToRoom(phase) if phase else _dr.ToRoom
                _owner = _fr if _fr is not None else _tr
                if _owner is None or _owner.Id != room.Id:
                    continue
                _rmats = door_reveal_paint(_host, _dr)
                if not _rmats:
                    continue
                _add_mats("Reveals", _rmats)
                for _mk, _av in _rmats.items():
                    _acc(elem_wall_paint, _host.Id, _av)
                    reveal_paint += _av
                reveal_count += 1
            except Exception:
                continue

    # Fallback wall area (net of arithmetic deductions) cannot be
    # attributed to a specific material - record it transparently.
    _fb_net = max(gross_wall - open_total - cw_total, 0.0)
    if _fb_net > 0.005:
        _add_mats("Walls", {FALLBACK_KEY: _fb_net})

    # ---- Parameters = SUM of room-visible material areas ----
    # Same measurement basis as Revit's 'Material: Area' (real face
    # areas, openings excluded, paint-aware) restricted to the room
    # boundary. Deriving the three parameters FROM the material
    # ledger makes 'parameter == sum of its material rows' true BY
    # CONSTRUCTION - one ledger, no parallel arithmetic to drift.
    def _sum_surface(_s):
        _t = 0.0
        for _key in room_mats:
            if _key[0] == _s:
                _t += room_mats[_key]
        return _t

    # Painted-only subset of a surface. This is the figure that
    # reconciles with Revit's Material Takeoff filtered on
    # 'Material: As Paint = Yes' (modulo room clipping); the
    # remainder is layer/substrate material, not a paint quantity.
    def _sum_surface_painted(_s):
        _t = 0.0
        for _key in room_mats:
            if _key[0] == _s and split_key(_key[1])[1]:
                _t += room_mats[_key]
        return _t

    # Painted door reveals are wall finish too - fold them into both
    # the finish total and the paint total (all reveal entries are
    # painted, so they add the same amount to each).
    net_wall = _sum_surface("Walls") + _sum_surface("Reveals")
    paint_wall = (_sum_surface_painted("Walls")
                  + _sum_surface_painted("Reveals"))
    floor_area = _sum_surface("Floor")
    ceiling_area = _sum_surface("Ceiling")

    ok_w = set_area(room, wall_param_name, net_wall)
    ok_p = set_area(room, paint_param_name, paint_wall)
    ok_f = set_area(room, floor_param_name, floor_area)
    ok_c = set_area(room, ceiling_param_name, ceiling_area)
    ok_n = set_area(room, net_floor_param_name, net_floor_slab)

    msg = ("{} | Wall net: {:.2f} SF"
           " [geometric {:.2f} SF on {} face(s)"
           " + fallback {:.2f} SF on {} face(s)"
           " - {} drs/wins {:.2f} - {} casework {:.2f}]"
           " | Floor: {:.2f} SF | Ceiling: {:.2f} SF").format(
        room_label(room), net_wall,
        wall_exact, exact_faces,
        gross_wall, fallback_faces,
        open_count, open_total, cw_count, cw_total,
        floor_area, ceiling_area)

    msg += (" | paint basis: {:.2f} SF painted"
            " + {:.2f} SF unpainted layer material").format(
        paint_wall, max(net_wall - paint_wall, 0.0))

    # Net (code-countable) floor area vs the full room footprint.
    _open_ded = max(room_footprint - net_floor_slab, 0.0)
    msg += (" | NET FLOOR (on slab): {:.2f} SF / {:.2f} m2"
            " [footprint {:.2f} SF - open-to-below {:.2f} SF / "
            "{:.2f} m2]").format(
        net_floor_slab, net_floor_slab * FT2_TO_M2,
        room_footprint, _open_ded, _open_ded * FT2_TO_M2)
    if open_below > 0.005:
        msg += " (no-slab footprint {:.2f} SF)".format(open_below)

    _srcs = ", ".join(
        "{} {:.2f} SF".format(k, ceil_src[k])
        for k in CEIL_SRC_ORDER if ceil_src[k] > 0.005)
    if _srcs:
        msg += " | ceiling from: " + _srcs

    if mezz_count > 0:
        msg += (" | mezzanine: {} slab(s) adding floor {:.2f} SF"
                " + ceiling {:.2f} SF").format(
            mezz_count, mezz_floor, mezz_ceil)
    if hangw_count > 0:
        msg += (" | interior walls: {} adding {:.2f} SF"
                " finish (both sides)").format(
            hangw_count, hangw_area)
    if reveal_count > 0:
        msg += (" | door reveals: {} opening(s) adding {:.2f} SF /"
                " {:.2f} m2 painted return").format(
            reveal_count, reveal_paint, reveal_paint * FT2_TO_M2)

    if virtual_side > 0:
        msg += " | excluded {:.2f} SF separation-line boundary".format(
            virtual_side)
    if ceiling_area == 0:
        msg += " | NOTE: no top boundary (no bounding ceiling?)"
    if floor_fb > 0:
        msg += (" | NOTE: {} floor face(s) via fallback (real slab,"
                " planar area; openings WITHIN that slab not deducted"
                " there)").format(floor_fb)
    if ceil_fb > 0:
        msg += (" | NOTE: {} ceiling face(s) via fallback"
                " (ceiling voids NOT deducted there)").format(ceil_fb)

    missing = [n for n, ok in
               [(wall_param_name, ok_w),
                (paint_param_name, ok_p),
                (floor_param_name, ok_f),
                (ceiling_param_name, ok_c),
                (net_floor_param_name, ok_n)] if not ok]
    if missing:
        msg += " | MISSING PARAMS: " + ", ".join(missing)

    report.append(msg)
    processed_count += 1

    # ---- Per-room per-material rows for the CSV export ----
    try:
        _rp = room.get_Parameter(BuiltInParameter.ROOM_NUMBER)
        _np = room.get_Parameter(BuiltInParameter.ROOM_NAME)
        _rnum = _rp.AsString() if _rp else ""
        _rnam = _np.AsString() if _np else ""
    except Exception:
        _rnum, _rnam = "", ""
    for (_surf, _mkey), _aval in room_mats.items():
        if _aval <= 0.005:
            continue
        _mname, _mcode, _mpaint = material_info(_mkey)
        csv_rows.append((_rnum, _rnam, _surf, _mname, _mcode,
                         u"Yes" if _mpaint else u"No",
                         _aval * FT2_TO_M2))

# ========= WRITE PER-ELEMENT TOTALS (element schedules) =========
# Same parameter names, bound by you (Manage > Project Parameters >
# add Walls / Floors / Ceilings / Roofs categories to the existing
# parameters). The script writes wherever the parameter exists and
# is writable; elements without it are skipped silently.
elems_written = 0
for _d, _pn in ((elem_wall_area, wall_param_name),
                (elem_wall_paint, paint_param_name),
                (elem_floor_area, floor_param_name),
                (elem_ceiling_area, ceiling_param_name)):
    for _eid in _d:
        try:
            _el = doc.GetElement(_eid)
            if _el is None:
                continue
            _p = _el.LookupParameter(_pn)
            if (_p and not _p.IsReadOnly
                    and _p.StorageType == StorageType.Double):
                _p.Set(_d[_eid])
                elems_written += 1
        except Exception:
            continue

# Optional per-wall breakdown STRING - the nearest in-schedule
# equivalent of a per-material-row value. Create a TEXT instance
# parameter named 'Wall Finish Breakdown' bound to Walls and every
# wall gets e.g. 'VEJ 3.12 m2 / VEK 5.28 m2' (room-clipped, code
# preferred, name where no code). Walls without the parameter are
# skipped silently.
TransactionManager.Instance.TransactionTaskDone()

# ================== CSV EXPORT (per room per material) ==============
if export_csv_path and csv_rows:
    try:
        import io
        with io.open(export_csv_path, "w", encoding="utf-8-sig") as fh:
            fh.write(u"Room Number,Room Name,Surface,Material,"
                     u"Material Code,Is Painted,Area (m2)\n")
            for r in csv_rows:
                vals = []
                for v in r[:6]:
                    s = u"{}".format(v).replace(u'"', u"'")
                    if u"," in s:
                        s = u'"' + s + u'"'
                    vals.append(s)
                fh.write(u",".join(vals) + u",{:.3f}\n".format(r[6]))
        _paint_rows = sum(1 for r in csv_rows if r[5] == u"Yes")
        _paint_m2 = sum(r[6] for r in csv_rows if r[5] == u"Yes")
        _other_m2 = sum(r[6] for r in csv_rows if r[5] != u"Yes")
        report.append("CSV EXPORT: {} material row(s) written to {}"
                      .format(len(csv_rows), export_csv_path))
        report.append(
            "PAINT SPLIT (all surfaces, all rooms): {} painted row(s) "
            "= {:.3f} m2 (filter Is Painted = Yes for the paint cost "
            "basis; this is what Revit's Material Takeoff counts under "
            "'Material: As Paint = Yes'), plus {:.3f} m2 on unpainted "
            "layer materials, which paint costing must exclude - or "
            "which flag finishes missing from the model."
            .format(_paint_rows, _paint_m2, _other_m2))
    except Exception as e:
        report.append("CSV EXPORT FAILED: {}".format(str(e)))

summary = ("[" + SCRIPT_VERSION + "] SUMMARY: measured {} placed "
           "room(s); ignored {} unplaced/"
           "unenclosed room(s). Wall mode: {}.").format(
    processed_count, skipped_unplaced,
    "GEOMETRIC (real finish faces, cuts excluded) with per-wall "
    "arithmetic fallback" if use_geometric else "arithmetic only")
report.insert(0, summary)

if elems_written > 0:
    report.append(
        "ELEMENT WRITE: finish-area totals written onto {} wall/"
        "floor/ceiling element(s) - visible in element schedules "
        "once the parameters are bound to those categories.".format(
            elems_written))

# ---- QC for the Wall Paint Area / takeoff reconciliation ----
report.append(
    "SCHEDULE FIX: to make a Wall Material Takeoff match this "
    "engine's painted CSV, schedule the NEW '{0}' field (NOT 'Wall "
    "Finish Area') and filter 'Material: As Paint = Yes'. Summed per "
    "material it equals the CSV's Is Painted = Yes rows. 'Wall Finish "
    "Area' still holds the whole finish face (paint + substrate), so "
    "summing IT per material over-reports paint by the unpainted "
    "layer area - that was the 31.72-vs-30.677 gap.".format(
        paint_param_name))

if multipaint_wall_ids:
    _mp_ids = ", ".join(_id_str(i) for i in multipaint_wall_ids)
    report.append(
        "QC - MULTI-PAINT WALLS: {} wall(s) carry more than one paint "
        "colour on their room face (split-face). '{}' stores one value "
        "per wall, so a takeoff would repeat it on each paint row and "
        "DOUBLE-COUNT these. Handle by hand or split the wall. "
        "Element Ids: {}".format(
            len(multipaint_wall_ids), paint_param_name, _mp_ids))

OUT = report
# ----------------------------------------
watch = Watch(python_script)
